# Dynamo custom node Convert_Dynamo_Point.dyf (Dynamo 2.13.1.3887)
# category: GeoLogic.Geometry
# Converts a list of Dynamo Points to a target type (such as list, tuple, xyz)

# group: INPUTS
PointsToConvert = Input(PointsToConvert: var[]..[])
options = Input(options: DesignScript.Builtin.Dictionary = DesignScript.Builtin.Dictionary.ByKeysValues(["wfm"], [0]))
ToBeReturned = Input(ToBeReturned: string = "list")

# group: Convert Points
point_convert = Python(IN[0]=PointsToConvert, IN[1]=options, IN[2]=ToBeReturned)  # CPython3
# ---------- point_convert.python (112 lines) ----------
# This node is developed by Johannes Beck, 2022.
# Contact: geotechnicalbim@gmail.com

# Imports for Revit / Dynamo
# Append path for site packages

debug = {}
import sys
import clr

clr.AddReference('ProtoGeometry')
from Autodesk.DesignScript.Geometry import *
from Autodesk.DesignScript.Geometry import Point as DynamoPoint

# Color Nodes from Dynamo
clr.AddReference('DSCoreNodes')
import DSCore
from DSCore import Color

# Import GeometryColor _ Display in Dynamo
clr.AddReference('GeometryColor')
from Modifiers import GeometryColor

# Import RevitNodes
clr.AddReference("RevitNodes")
import Revit

# Import Revit elements
from Revit.Elements import *
import System

# Import DocumentManager and Transaction Manger
clr.AddReference("RevitServices")
import RevitServices
from RevitServices.Persistence import DocumentManager
from RevitServices.Transactions import TransactionManager

# Revit API
clr.AddReference('RevitAPI')
from Autodesk.Revit.DB import *
from Autodesk.Revit.DB.Structure import *

# Revit API Usier Ingerfavce
clr.AddReference('RevitAPIUI')
from Autodesk.Revit.UI import *


# Assign Inputs IN of the python node
input0 = IN[0]
ToBeReturned = IN[2]

# Allows nested lists / dicts / tuples in the input 0. Two dimensonal only. 
if not hasattr(input0, '__iter__'):
    to_be_flattend = True
    input0 = [input0]
    out0 = [[]]
else: 
    to_be_flattend = False
    out0 = []


def point_convert(points, ToBeReturned="tuple"):
    if isinstance(points[0], DynamoPoint):
        converted = points if ToBeReturned in ["DynamoPoints"] else []
        if ToBeReturned in ["list", "List"]:
            for point in points:
                converted.append([point.X, point.Y, point.Z])
        elif ToBeReturned in ["dict", "Dictionary", "Dict"]:
            converted = {}
            for point in points:
                converted.update({"x": point.X, "y": point.Y, "z": point.Z})
        elif ToBeReturned in ["tuple", "Tuple"]:
            for point in points:
                converted.append((point.X, point.Y, point.Z))                    
        elif ToBeReturned in ["xyz", "XYZ", "RevitPoint", "Revit"]:
            for point in points:
                converted.append(XYZ(point.X, point.Y, point.Z))
        
        return converted
    
    elif isinstance(points, list) or isinstance(points, tuple) :
        converted = points if ToBeReturned in ["list", "List"] else []
        converted.append("Requested output type not implemented yet")
    #    return converted
    
    #elif isinstance(points, dict):
    #    converted=["hi"]
    #    for point in points:
    #        converted.append(type(points[0]))
    #    return converted
        
    else:
        return "Input is not a Dynamo Point list. Type is {}".format(type(points))    
        
try:
    # your code here
    if isinstance(input0[0], DynamoPoint): 
        out0.append(point_convert(input0, ToBeReturned=ToBeReturned))
    else:
        for point_list in input0:
            out0.append(point_convert(point_list, ToBeReturned=ToBeReturned))


except (ZeroDivisionError, ValueError, IndexError, AttributeError, NameError) as err:
    debug.update({"Error":err})


if to_be_flattend==True:
    out0 = out0[0]


OUT = out0, debug
# ----------------------------------------
code_block = CodeBlock(lst=point_convert) { points=lst[0]; debug=lst[1]; }

# group: Output
Converted = Output(code_block.points)
debug = Output(code_block.debug)
