# Dynamo custom node EA_Pfaehle_Tab_5_12.dyf (Dynamo 2.13.1.3887)
# category: GeoLogic.Calculations
# Calculates q_bk for bored piles in non-cohesive soils based on a given q_c

# group: INPUT
q_c = Input(q_c: var[]..[])
options = Input(options: DesignScript.Builtin.Dictionary = DesignScript.Builtin.Dictionary.ByKeysValues(["wfm"], [0]))

# group: get q_bk
EA_Pfaehle_Tab_5_12 = Python(IN[0]=q_c, IN[1]=options)  # CPython3
# ---------- EA_Pfaehle_Tab_5_12.python (64 lines) ----------
# This node is developed by Johannes Beck, 2022.
# Contact: geotechnicalbim@gmail.com

# Imports for Revit / Dynamo
# Append path for site packages

debug = {}
input0 = IN[0]

if len(IN) > 1:
    options = IN[1]

if not hasattr(input0, '__iter__'):
    to_be_flattend = True
    input0 = [input0]
else: to_be_flattend = False

def Tab_5_12(list):
# Hier werden erst temporäre Listen (indiziert mit t am Ende) erstellt, und dann wird der maßgebende Wert aus diesen Listen extrahiert. Der maßgebende Wert ist erstmal der Wert der untersten Schicht, in den der Pfahl einbindet. Das ist mit den Indizes der untersten tragfähigen Schicht abzuglichen.
# weitere Inputs für diese Funktion sind die Index Listen, die aber bei der vorgesehenen Verwendung global sind und daher nicht zwingend als Argument in die Funktion müssen
	q_bk_002t, q_bk_003t, q_bk_010t = [], [], []
	for i in list:
		if i < 7.5:
			q_bk_002t.append(0)
			q_bk_003t.append(0)
			q_bk_010t.append(0)
		elif i >= 7.5 and i < 15:
			# Lineares interpolieren der Zwischenschritte
			a = 550 + (1050-550)*((i-7.5)/(15-7.5))
			b = 700 + (1350-700)*((i-7.5)/(15-7.5))
			c = 1600 + (3000-1600)*((i-7.5)/(15-7.5))
			q_bk_002t.append(a)
			q_bk_003t.append(b)
			q_bk_010t.append(c)
		elif i >= 15 and i < 25:
			a = 1050 + (1750-1050)*((i-15)/(25-15)) 
			b = 1350 + (2250-1350)*((i-15)/(25-15)) 
			c = 3000 + (4000-3000)*((i-15)/(25-15)) 
			q_bk_002t.append(a)
			q_bk_003t.append(b)
			q_bk_010t.append(c)
		elif i >= 25:
			a = 1750
			b = 2250
			c = 4000
			q_bk_002t.append(a)
			q_bk_003t.append(b)
			q_bk_010t.append(c)
		else:
			a = b = c = "Unexpected Error"
			q_bk_002t.append(a)
			q_bk_003t.append(b)
			q_bk_010t.append(c)
	return [q_bk_002t, q_bk_003t, q_bk_010t]


q_bk_out=Tab_5_12(input0)

if to_be_flattend==True:
    q_bk_out = q_bk_out[0]

debug.update({"info":"Calculates q_bk (pile end bearing) based on a given q_c according to 'Tabelle 5.12 der Empfehlungen des Arbeitskreises Pfähle, EA-Pfähle 2016'. Results are retruned for s/Ds = 0.02, 0.03 and 0.10", "Anwendungsbereich":"bored piles in non-cohesive soils"}) 

OUT = q_bk_out, debug
# ----------------------------------------
code_block = CodeBlock(a=EA_Pfaehle_Tab_5_12) { a[0]; a[1]; }

# group: OUTPUT
q_bk = Output(code_block.out0)
debug = Output(code_block.out1)
