# Dynamo custom node EA_Pfaehle_Tab_5_13.dyf (Dynamo 2.13.1.3887)
# category: GeoLogic.Calculations
# gets q_sk for a bored pile in non-cohesive soils based on a given q_c

# group: INPUT
q_c = Input(q_c: var[]..[])
options = Input(options: DesignScript.Builtin.Dictionary = DesignScript.Builtin.Dictionary.ByKeysValues(["wfm"], [0]))

# group: get q_sk
n13 = Python(IN[0]=q_c, IN[1]=options)  # "EA_Pfaehle_Tab5.13"; CPython3
# ---------- n13.python (37 lines) ----------
# This node is developed by Johannes Beck, 2022.
# Contact: geotechnicalbim@gmail.com


input0 = IN[0]

if not hasattr(input0, '__iter__'):
    to_be_flattend = True
    input0 = [input0]
else: to_be_flattend = False

def Tab_5_13(list):
    q_sk = []
    for i in list:
        if i < 7.5:
            q_sk.append(0)
        elif i >= 7.5 and i < 15:
        # Lineares interpolieren der Zwischenschritte
            a = 55 + (105-55)*((i-7.5)/(15-7.5))
            q_sk.append(a)
        elif i >= 15 and i < 25:
            a = 105 + (130-105)*((i-15)/(25-15)) 
            q_sk.append(a)
        elif i >= 25:
            q_sk.append(130)
        else:
            q_sk.append("Unexpected Error")
    return q_sk

q_sk_out=Tab_5_13(input0)

if to_be_flattend==True:
    q_sk_out = q_sk_out[0]
    

debug = {"info":"Calculates q_sk (skin friction) based on a given q_c according to 'Tabelle 5.13 der Empfehlungen des Arbeitskreises Pfähle, EA-Pfähle 2016'.", "Anwendungsbereich":"bored piles in non-cohesive soils"} 
OUT = q_sk_out, debug
# ----------------------------------------
code_block = CodeBlock(a=n13) { b=a[0]; c=a[1]; }

# group: OUTPUT
q_sk = Output(code_block.b)
debug = Output(code_block.c)
