# Dynamo custom node EA_Pfaehle_Tab_5_14.dyf (Dynamo 2.13.1.3887)
# category: GeoLogic.Calculations
# Calculates the q_bk for a bored pile in cohesive soils given its c_uk

# group: INPUTS
c_uk = Input(c_uk: var[]..[])
options = Input(options: DesignScript.Builtin.Dictionary = DesignScript.Builtin.Dictionary.ByKeysValues(["wfm"], [0]))

# group: get q_bk
EA_Pfaehle_Tab_5_14 = Python(IN[0]=c_uk, IN[1]=options)  # CPython3
# ---------- EA_Pfaehle_Tab_5_14.python (57 lines) ----------
# This node is developed by Johannes Beck, 2022.
# Contact: geotechnicalbim@gmail.com

debug = {}
input0 = IN[0]

if not hasattr(input0, '__iter__'):
    to_be_flattend = True
    input0 = [input0]
else: to_be_flattend = False

# based on implementation of Tab 5_12
def Tab_5_14(list):
	q_bk_002t, q_bk_003t, q_bk_010t = [], [], []
	for i in list:
		if i < 100:
			q_bk_002t.append(0)
			q_bk_003t.append(0)
			q_bk_010t.append(0)
		elif i >= 100 and i < 150:
			# Lineares interpolieren der Zwischenschritte
			a = 350 + (600-350)*((i-100)/(150-100))
			b = 450 + (700-450)*((i-100)/(150-100))
			c = 800 + (1200-800)*((i-100)/(150-100))
			q_bk_002t.append(a)
			q_bk_003t.append(b)
			q_bk_010t.append(c)
		elif i >= 150 and i < 250:
			a = 600 + (950-600)*((i-150)/(250-150)) 
			b = 700 + (1200-700)*((i-150)/(250-150)) 
			c = 1200 + (1600-1200)*((i-150)/(250-150)) 
			q_bk_002t.append(a)
			q_bk_003t.append(b)
			q_bk_010t.append(c)
		elif i >= 250:
			a = 950
			b = 1200
			c = 1600
			q_bk_002t.append(a)
			q_bk_003t.append(b)
			q_bk_010t.append(c)
		else:
			a = b = c = "Unexpected Error"
			q_bk_002t.append(a)
			q_bk_003t.append(b)
			q_bk_010t.append(c)
	return [q_bk_002t, q_bk_003t, q_bk_010t]

q_bk_out=Tab_5_14(input0)

if to_be_flattend==True:
    q_bk_out = q_bk_out[0]

debug.update({"info":"Calculates q_bk (pile end bearing) based on a given c_uk according to 'Tabelle 5.14 der Empfehlungen des Arbeitskreises Pfähle, EA-Pfähle 2016'. Results are retruned for s/Ds = 0.02, 0.03 and 0.10", "Anwendungsbereich":"bored piles in cohesive soils"}) 


OUT = q_bk_out, debug
# ----------------------------------------
code_block = CodeBlock(a=EA_Pfaehle_Tab_5_14) { b=a[0]; c= a[1]; }

# group: OUTPUT
q_bk = Output(code_block.b)
debug = Output(code_block.c)
