# Dynamo custom node EA_Pfaehle_Tab_5_15.dyf (Dynamo 2.13.1.3887)
# category: GeoLogic.Calculations
# Calculates the q_sk for bored piles in cohesive soils based on given c_uk

# group: INPUT
c_uk = Input(c_uk: var[]..[])
options = Input(options: DesignScript.Builtin.Dictionary = DesignScript.Builtin.Dictionary.ByKeysValues(["wfm"], [0]))

# group: get q_sk
n15 = Python(IN[0]=c_uk, IN[1]=options)  # "EA_Pfaehle_Tab5.15"; CPython3
# ---------- n15.python (37 lines) ----------
# This node is developed by Johannes Beck, 2022.
# Contact: geotechnicalbim@gmail.com

# Imports for Revit / Dynamo
input0 = IN[0]

if not hasattr(input0, '__iter__'):
    to_be_flattend = True
    input0 = [input0]
else: to_be_flattend = False

def Tab_5_15(list):
    q_sk = []
    for i in list:
        if i < 60:
            q_sk.append(0)
        elif i >= 60 and i < 150:
        # Lineares interpolieren der Zwischenschritte
            a = 30 + (50-30)*((i-60)/(150-60))
            q_sk.append(a)
        elif i >= 150 and i < 250:
            a = 50 + (65-50)*((i-150)/(250-150)) 
            q_sk.append(a)
        elif i >= 250:
            q_sk.append(65)
        else:
            q_sk.append("Unexpected Error")
    return q_sk

q_sk_out=Tab_5_15(input0)

if to_be_flattend==True:
    q_sk_out = q_sk_out[0]

debug = {"info":"Calculates q_sk (skin friction) based on a given c_uk according to 'Tabelle 5.15 der Empfehlungen des Arbeitskreises Pfähle, EA-Pfähle 2016'.", "Anwendungsbereich":"bored piles in cohesive soils"} 

OUT = q_sk_out, debug
# ----------------------------------------
code_block = CodeBlock(a=n15) { b=a[0]; c= a[1]; }

# group: OUTPUT
q_sk = Output(code_block.b)
debug = Output(code_block.c)
