# Dynamo custom node EA_Pfaehle_Tab_5_16.dyf (Dynamo 2.13.1.3887)
# category: GeoLogic.Calculations
# Calculates q_bk and q_sk for bored piles in rock for given q_uk

# group: INPUTS
q_uk = Input(q_uk: var[]..[])
options = Input(options: DesignScript.Builtin.Dictionary = DesignScript.Builtin.Dictionary.ByKeysValues(["wfm"], [0]))

# group: get q_sk and q_bk
n16 = Python(IN[0]=q_uk, IN[1]=options)  # "EA_Pfaehle_Tab5.16"; CPython3
# ---------- n16.python (47 lines) ----------
# This node is developed by Johannes Beck, 2022.
# Contact: geotechnicalbim@gmail.com

# Imports for Revit / Dynamo
input0 = IN[0]

if not hasattr(input0, '__iter__'):
    to_be_flattend = True
    input0 = [input0]
else: to_be_flattend = False

def Tab_5_16(list):
    q_sk, q_bk = [], [] 
    for i in list:
        if i < 0.5:
            q_sk.append(0)
            q_bk.append(0)
        elif i >= 0.5 and i < 5.0:
        # Lineares interpolieren der Zwischenschritte
            a = 70 + (500-70)*((i-0.5)/(5-0.5))
            q_sk.append(a)
            b = 1500 + (5000-1500)*((i-0.5)/(5-0.5))
            q_bk.append(b)
        elif i >= 5 and i < 20:
            a = 500 #+ (500-500)*((i-5)/(20-5)) 
            q_sk.append(a)
            b =  5000 + (10000-5000)*((i-5)/(20-5)) 
            q_bk.append(b)
        elif i >= 20:
            q_sk.append(500)
            q_bk.append(10000)
        else:
            q_sk.append("Unexpected Error")
            q_bk.append("Unexpected Error")
    return q_sk, q_bk

q_sk_out=Tab_5_16(input0)[0]
q_bk_out=Tab_5_16(input0)[1]

if to_be_flattend==True:
    q_sk_out = q_sk_out[0]
    q_bk_out = q_bk_out[0]

debug={"info":"Calculates q_sk (skin friction) and q_bk (pile end bearing) based on a given q_uk according to 'Tabelle 5.16 der Empfehlungen des Arbeitskreises Pfähle, EA-Pfähle 2016'.", "Anwendungsbereich":"bored piles in rock soils"}


OUT = q_sk_out, q_bk_out, debug
# ----------------------------------------
code_block = CodeBlock(a=n16) { b=a[0]; c= a[1]; d = a[2]; }

# group: OUTPUT
q_sk = Output(code_block.b)
q_bk = Output(code_block.c)
debug = Output(code_block.d)
