# Dynamo custom node Earth_Pressure_Coefficient.dyf (Dynamo 2.13.1.3887)
# category: GeoLogic.Calculations
# Calculates the earth pressure coefficients. See info (debug dict) for help.

# group: INPUTS
alpha = Input(alpha: double = 0)
beta = Input(beta: double = 0)
phi = Input(phi: double = 30)
delta_a = Input(delta_a: double = 2 / 3)
delta_p = Input(delta_p: double = 0)
c = Input(c: double = 0)
options = Input(options: DesignScript.Builtin.Dictionary = DesignScript.Builtin.Dictionary.ByKeysValues(["wfm"], [0]))

# group: Calculate
erddruck = Python(IN[0]=alpha, IN[1]=beta, IN[2]=phi, IN[3]=delta_a, IN[4]=delta_p, IN[5]=c, IN[6]=options)  # CPython3
# ---------- erddruck.python (179 lines) ----------
# Die Eingaben für diesen Block werden in Form einer Liste in den IN-Variablen gespeichert.
alpha = IN[0]
beta = IN[1]
phi = IN[2]
delta_a = phi*IN[3]
delta_p = phi* IN[4]
c = IN[5]
options = IN[6]

debug = {}

# if not specified, what the user wants to see, show everything
#if not bool(options):
#    options=['K_agh', 'theta_a', 'K_aph', 'K_ach', 'K_pgh_Katzenbach', 'K_pgh', 'K_pph', 'K_pch', 'theta_p']

if "coeffs" not in options.keys():
    options.update({"coeffs":['K_agh', 'theta_a', 'K_aph', 'K_ach', 'K_pgh_Katzenbach', 'K_pgh', 'K_pph', 'K_pch', 'theta_p']})

# Code unterhalb dieser Linie platzieren
import math

def K_agh (alpha, beta, delta_a, phi):
    alpha = math.radians(alpha); beta = math.radians(beta); delta_a = math.radians(delta_a); phi = math.radians(phi)
    K_agh = (math.cos(phi - alpha)**2) / (math.cos(alpha)**2*(1+((math.sin(phi + delta_a)*math.sin(phi - beta))/(math.cos(alpha + delta_a) * math.cos(alpha - beta)))**0.5)**2)
    return K_agh

def theta_a (alpha, beta, delta_a, phi):
    alpha = math.radians(alpha); beta = math.radians(beta); delta_a = math.radians(delta_a); phi = math.radians(phi)
    theta_a = phi + math.atan(math.cos(phi-alpha)/(math.sin(phi-alpha)+((math.sin(phi + delta_a)*math.cos(alpha - beta))/(math.sin(phi - beta)*math.cos(delta_a + alpha)))**0.5))
    return math.degrees(theta_a)

def K_aph (alpha, beta, delta_a, phi):
    a = K_agh(alpha, beta, delta_a, phi)
    alpha = math.radians(alpha); beta = math.radians(beta)
    K_aph = a * ((math.cos(alpha)*math.cos(beta))/(math.cos(alpha-beta)))
    return K_aph

def K_ach  (alpha, beta, delta_a, phi):
    a = K_agh(alpha, beta, delta_a, phi)
    alpha = math.radians(alpha); beta = math.radians(beta); delta = math.radians(delta_a); phi = math.radians(phi)
    K_ach = a**0.5 * math.cos(delta_a) * (2)
    K_ach_var = (2 * math.cos(alpha-beta)*math.cos(phi)*math.cos(alpha+delta))/(math.cos(alpha)*(1+math.sin(phi+alpha+delta-beta)))
    return K_ach_var

def K_pgh_Katzenbach (alpha, beta, delta_p, phi):
    # Nach Katzebbach
    alpha = math.radians(alpha); beta = math.radians(beta); delta_p = math.radians(delta_p); phi = math.radians(phi)
    K_pgh = (math.cos(phi + alpha) ** 2) / (math.cos(alpha) ** 2 * (1 - ((math.sin(phi - delta_p) * math.sin(phi + beta))\
    / (math.cos(alpha + delta_p) * math.cos(alpha - beta))) ** 0.5) ** 2)
    return (K_pgh)

def K_pgh(alpha, beta, delta_p, phi):
    alpha = math.radians(alpha); beta = math.radians(beta); delta_p = math.radians(delta_p); phi = math.radians(phi)
    # nach Pregl, siehe z.B. https://link.springer.com/content/pdf/10.1007%2F978-3-658-14931-4_16.pdf
    if phi > 0:
        if delta_p <= 0:
            i_pg = (1-0.53*delta_p)**(0.26+5.96*phi)
        else:
            i_pg = (1+0.41*delta_p)**(-7.13)
        if beta <= 0:
            g_pg = (1+0.73*beta)**2.89
        else:
            g_pg = (1+0.35*beta)**(0.42+8.15*phi)
        if alpha <= 0:
            t_pg = (1+0.72*alpha*math.tan(phi))**(-3.51+1.03*phi)
        else:
            t_pg = (1-0.0012*alpha*math.tan(phi))**(2910-1958*phi)
        K_pg0 = (1+math.sin(phi))/(1-math.sin(phi))
        K_pg = K_pg0 * i_pg * g_pg * t_pg
    elif phi == 0:
        K_pg = K_pp = 1
        K_pc = (2*(1+beta)*(1-alpha))/math.cos(alpha)
    K_pgh = K_pg * math.cos(delta_p+alpha)
    return K_pgh

def K_pph(alpha, beta, delta_p, phi):
    alpha = math.radians(alpha); beta = math.radians(beta); delta_p = math.radians(delta_p); phi = math.radians(phi)
    # nach Pregl
    if phi > 0:
        if delta_p <= 0:
            i_pp = (1-1.33*delta_p)**(0.08+2.37*phi)
        else:
            i_pp = (1-0.72*delta_p)**2.81
        if beta <= 0:
            g_pp = (1+1.16*beta)**1.57
        else:
            g_pp = (1+3.84*beta)**(0.98*phi)
        if alpha <= 0:
            t_pp = (math.exp(-2*alpha*math.tan(phi)))/math.cos(alpha)
        else:
            t_pp = (math.exp(-2*alpha*math.tan(phi)))/math.cos(alpha)
        K_pp0 = (1+math.sin(phi))/(1-math.sin(phi))
        K_pp = K_pp0 * i_pp * g_pp * t_pp
    elif phi == 0:
        K_pp = 1
    K_pph = K_pp * math.cos(delta_p+alpha)
    return K_pph

def K_pch(alpha, beta, delta_p, phi):
    alpha = math.radians(alpha); beta = math.radians(beta); delta_p = math.radians(delta_p); phi = math.radians(phi)
    # nach Pregl
    if phi > 0:
        if delta_p <= 0:
            i_pc = (1-1.33*delta_p)**(0.08+2.37*phi)
        else:
            i_pc = (1+4.46*delta_p*math.tan(phi))**(-1.14+0.57*phi)
        if beta <= 0:
            g_pc = (1 + 0.001 * beta * math.tan(phi))**(205.4 + 2332 * phi)
        else:
            g_pc = math.exp(2*beta*math.tan(phi))
        if alpha <= 0:
            t_pc = (math.exp(-2*alpha*math.tan(phi)))/math.cos(alpha)
        else:
            t_pc = t_pp = (math.exp(-2*alpha*math.tan(phi)))/math.cos(alpha)
        K_pp0 = (1 + math.sin(phi)) / (1 - math.sin(phi))
        K_pc0 = (K_pp0-1)*(math.tan(phi)**(-1))
        K_pc = K_pc0 * i_pc * g_pc * t_pc
    elif phi == 0:
        K_pc = (2*(1+beta)*(1-alpha))/math.cos(alpha)
    K_pch = K_pc * math.cos(delta_p+alpha)
    return K_pch

def theta_p (alpha, beta, delta_p, phi):
    # nach Müller Breslau
    alpha = math.radians(alpha); beta = math.radians(beta); delta_p = math.radians(delta_p); phi = math.radians(phi)
    theta_p = (-1)*(phi) + math.atan(((-1)*math.tan(alpha + phi)+math.cos(alpha+phi)**(-1)\
                                      *((math.sin(delta_p-phi)*math.cos(alpha-beta))\
                                        /((-1)*math.sin(phi+beta)*math.cos(delta_p+alpha)))**0.5)**(-1))
    theta_p = math.degrees(theta_p)
    return theta_p

# Input in Grad
#alpha = 0
#beta = 0
#phi = 30
#delta_a = (2/3)*phi
#delta_p = 0*(-2/3)*phi
#c = 0


out1= {}
for coeff in options["coeffs"]:
    if coeff == 'K_agh':
        coeff1=K_agh(alpha, beta, delta_a, phi)
    elif coeff == 'theta_a':
        coeff1=theta_a(alpha, beta, delta_a, phi)
    elif coeff =='K_aph':
        coeff1=K_aph(alpha, beta, delta_a, phi)
    elif coeff =='K_ach':
        coeff1=K_ach(alpha, beta, delta_a, phi)
    elif coeff =='K_pgh_Katzenbach':
        coeff1=K_pgh_Katzenbach(alpha, beta, delta_p, phi)
    elif coeff =='K_pgh':
        coeff1=K_pgh(alpha, beta, delta_p, phi)
    elif coeff == 'K_pph':
        coeff1=K_pph(alpha, beta, delta_p, phi)
    elif coeff =='K_pch':
        coeff1=K_pch(alpha, beta, delta_p, phi)
    elif coeff =='theta_p':
        coeff1=theta_p (alpha, beta, delta_p, phi)
    else:
        coeff1="!!! Please check options. Invalid Input. See info for more information"
    
    out1.update({coeff : coeff1})
    



debug.update({"info" : "This node calculates earth pressure coefficients based on given numerical values for alpha, beta (geometry), phi, c (soil), delta_a, delta_p (soil_structure_interaction). The deltas are given in parts of phi, e.g. 0.5 or 2/3 would be a valid input. Alpha and beta expect degree values. Options determin, what shall be returned. They are passed as a list of strings. Max. possible is ['K_agh', 'theta_a', 'K_aph', 'K_ach', 'K_pgh_Katzenbach', 'K_pgh', 'K_pph', 'K_pch', 'theta_p']"})
#print(K_aph(alpha, beta, delta_a, phi))
#print(theta_a(alpha, beta, delta_a, phi))
#print(K_agh(alpha, beta, delta_a, phi))
#print(K_ach(alpha, beta, delta_a, phi))
#print("Kpgh nach Katzenbach _ gerade Gleitfäche = " + str(K_pgh_Katzenbach(alpha, beta, delta_p, phi,)))
#print(theta_p(alpha, beta, delta_p, phi))
#print(K_pch(alpha, beta, delta_p, phi))
#print(K_agh(15, 0, delta_a, 30))
# Weisen Sie Ihre Ausgabe der OUT-Variablen zu.
OUT = debug, out1
# ----------------------------------------
code_block = CodeBlock(a=erddruck) { debug=a[0]; python_out=a[1]; }

# group: OUTPUTS
earth_pressure_coefficient = Output(code_block.python_out)
debug = Output(code_block.debug)
