# Dynamo custom node Geom_To_Voxel.dyf (Dynamo 2.13.1.3887)
# category: GeoLogic.Geometry
# Converts a geometry to its voxel representation.

# group: INPUT
GeomToBeVoxelized = Input(GeomToBeVoxelized: var)
voxel_size_x = Input(voxel_size_x: double = 5)
voxel_size_y = Input(voxel_size_y: double = 5)
voxel_size_z = Input(voxel_size_z: double = 5)
options = Input(options: DesignScript.Builtin.Dictionary = DesignScript.Builtin.Dictionary.ByKeysValues(["wfm"], [0]))

# group: BBox of input geometry
byGeometry = BoundingBox.ByGeometry(geom=GeomToBeVoxelized)
minPoint = BoundingBox.MinPoint(boundingBox=byGeometry)
code_block = CodeBlock(P1=minPoint) { P1.X; P1.Y; P1.Z; }
maxPoint = BoundingBox.MaxPoint(boundingBox=byGeometry)
code_block_2 = CodeBlock(P2=maxPoint) { P2.X; P2.Y; P2.Z; }

# group: Create 3D Point Grid inside Bbox
code_block_3 = CodeBlock(x1=code_block.out0, x2=code_block_2.out0, SizeX=voxel_size_x, y1=code_block.out1, y2=code_block_2.out1, SizeY=voxel_size_y, z1=code_block.out2, z2=code_block_2.out2, SizeZ=voxel_size_z) { x1..x2+SizeX..SizeX; y1..y2+SizeY..SizeY; z1..z2+SizeZ..SizeZ; }
byCoordinates = Point.ByCoordinates(x=code_block_3.out0, y=code_block_3.out1, z=code_block_3.out2, lacing=CrossProduct)
flatten = List.Flatten(list=byCoordinates)

max_abstand_voxelecken = Python(IN[0]=voxel_size_x, IN[1]=voxel_size_y, IN[2]=voxel_size_z)  # CPython3
# ---------- max_abstand_voxelecken.python (15 lines) ----------
# Phython-Standard- und DesignScript-Bibliotheken laden
import sys
import clr
clr.AddReference('ProtoGeometry')
from Autodesk.DesignScript.Geometry import *

# Die Eingaben für diesen Block werden in Form einer Liste in den IN-Variablen gespeichert.
x1 = IN[0]
y1 = IN[1]
z1 = IN[2]

# Code unterhalb dieser Linie platzieren

# Weisen Sie Ihre Ausgabe der OUT-Variablen zu.
OUT = (((x1**2+y1**2)**0.5)**2+z1**2)**0.5
# ----------------------------------------

# group: Get the points on the BBox
byCoordinates_2 = Point.ByCoordinates(x=code_block_3.out0, y=code_block_3.out1, z=code_block_2.out2, lacing=CrossProduct)
# note: TOP
byCoordinates_3 = Point.ByCoordinates(x=code_block_3.out0, y=code_block_3.out1, z=code_block.out2, lacing=CrossProduct)
byCoordinates_4 = Point.ByCoordinates(x=code_block_2.out0, y=code_block_3.out1, z=code_block_3.out2, lacing=CrossProduct)
# note: Side1
byCoordinates_5 = Point.ByCoordinates(x=code_block.out0, y=code_block_3.out1, z=code_block_3.out2, lacing=CrossProduct)
# note: Side2
# note: Side3
byCoordinates_6 = Point.ByCoordinates(x=code_block_3.out0, y=code_block.out1, z=code_block_3.out2, lacing=CrossProduct)
# note: Side4
byCoordinates_7 = Point.ByCoordinates(x=code_block_3.out0, y=code_block_2.out1, z=code_block_3.out2, lacing=CrossProduct)
# note: Bottom
list_create = List.Create(item0=byCoordinates_2, item1=byCoordinates_3, item2=byCoordinates_4, item3=byCoordinates_5, item4=byCoordinates_6, item5=byCoordinates_7)
flatten_2 = List.Flatten(list=list_create)

# group: Evaluate distance of points in pointgrid to Geometry
distanceTo = Geometry.DistanceTo(geometry=GeomToBeVoxelized, other=flatten, lacing=Longest)
evaluate_point_positions = Python(IN[0]=distanceTo, IN[1]=flatten, IN[2]=max_abstand_voxelecken, IN[3]=GeomToBeVoxelized, IN[4]=flatten_2)  # CPython3
# ---------- evaluate_point_positions.python (31 lines) ----------
# Phython-Standard- und DesignScript-Bibliotheken laden
import sys
import clr
clr.AddReference('ProtoGeometry')
from Autodesk.DesignScript.Geometry import *

# Die Eingaben für diesen Block werden in Form einer Liste in den IN-Variablen gespeichert.
Distances = IN[0]
AllPoints = IN[1]
MaxAbstand = IN[2]
GeometryToVoxel = IN[3]
BBoxPoints = IN[4]
Zeros = []
CenterPoints = []
ShellCenterPoints = []

for i in range(len(Distances)):
    if Distances[i] <= 0.5*MaxAbstand:
        CenterPoints.append(AllPoints[i])
    if Distances[i] <= 0.5*MaxAbstand and Distances[i] > 0:
        ShellCenterPoints.append(AllPoints[i])
    #if Distances[i] == 0:
     #   Zeros.append(AllPoints[i])

for point in CenterPoints:
    if point in BBoxPoints and point not in ShellCenterPoints:
        ShellCenterPoints.append(point)
    
# Testing for shell: Scaling up by 1.0001, so in case point is on the surface of Geometry -> Again check distances etc

OUT = CenterPoints, ShellCenterPoints
# ----------------------------------------

# group: ALL CENTER POINTS TO CUBOID
code_block_4 = CodeBlock { 0; }
getItemAtIndex = List.GetItemAtIndex(list=evaluate_point_positions, index=code_block_4)
byLengths = Cuboid.ByLengths(origin=getItemAtIndex, width=voxel_size_x, length=voxel_size_y, height=voxel_size_z)

# group: SHELL CENTER POINTS TO CUBOID
code_block_5 = CodeBlock { 1; }
getItemAtIndex_2 = List.GetItemAtIndex(list=evaluate_point_positions, index=code_block_5)
byLengths_2 = Cuboid.ByLengths(origin=getItemAtIndex_2, width=voxel_size_x, length=voxel_size_y, height=voxel_size_z)

# group: INFO / WFM
options_manager = Python(IN[0]=options, IN[1]=byGeometry, IN[2]=evaluate_point_positions)  # CPython3
# ---------- options_manager.python (27 lines) ----------
# This node is developed by Johannes Beck, 2022.
# Contact: geotechnicalbim@gmail.com

# Imports for Revit / Dynamo
# Append path for site packages

import sys
import clr

bbox = IN[1]
positions = IN[2] 
debug = {}
debug.update({"info": "This node voxelizes a given geometry. High resolutions result in long computational times."})


if bool(bbox):
    debug.update({"Bbox successfully created?" : True})    
else:
    debug.update({"Bbox successfully created?" : False})     

if bool(positions):
    debug.update({"Point positions successfully evaluated?" : True})    
else:
    debug.update({"Point positions successfully evaluated?" : False})  


OUT = debug
# ----------------------------------------

# group: OUTPUT
AllVoxels = Output(byLengths)
ShellVoxels = Output(byLengths_2)
debug = Output(options_manager)
