# Dynamo custom node Get_Fill_Pattern_Element_By_Name.dyf (Dynamo 2.10.1.3976)
# category: GeoLogic.Utils
# Gets a Fill Pattern Element given its name as a string. Fill pattern needs to be inside current Revit doc.

# group: Input
NameOfPattern = Input(NameOfPattern: var[]..[])
options = Input(options: DesignScript.Builtin.Dictionary = DesignScript.Builtin.Dictionary.ByKeysValues(["wfm_in"], [0]))

# group: Get Pattern by a given string
getPatternByName = Python(IN[0]=NameOfPattern, IN[1]=options)  # CPython3
# ---------- getPatternByName.python (111 lines) ----------
# This node is developed by Johannes Beck, 2022.
# Contact: geotechnicalbim@gmail.com


# Testet against Revit 2022



# Imports for Revit / Dynamo
# Append path for site packages
import System
debug = {}

import sys
import clr
import os


clr.AddReference('ProtoGeometry')
from Autodesk.DesignScript.Geometry import *
from Autodesk.DesignScript.Geometry import Point as DynamoPoint

# Color Nodes from Dynamo
clr.AddReference('DSCoreNodes')
import DSCore
from DSCore import Color

# Import GeometryColor _ Display in Dynamo
clr.AddReference('GeometryColor')
from Modifiers import GeometryColor

# Import RevitNodes
clr.AddReference("RevitNodes")
import Revit

# Import Revit elements
from Revit.Elements import *
import System

# Import DocumentManager and Transaction Manger
clr.AddReference("RevitServices")
import RevitServices
from RevitServices.Persistence import DocumentManager
from RevitServices.Transactions import TransactionManager

# Revit API
clr.AddReference('RevitAPI')
from Autodesk.Revit.DB import *
from Autodesk.Revit.DB.Structure import *

# Revit API Usier Ingerfavce
clr.AddReference('RevitAPIUI')
from Autodesk.Revit.UI import *


doc = DocumentManager.Instance.CurrentDBDocument
uidoc=DocumentManager.Instance.CurrentUIApplication.ActiveUIDocument
#Preparing input from dynamo to revit
#element = UnwrapElement(IN[0])


# Assign Inputs IN of the python node
input0 = IN[0]
if len(IN) > 1:
    options = IN[1]
    wfm_in = options["wfm_in"] if "wfm_in" in options.keys() else 0
    if not bool(wfm_in) or type(wfm_in)!=int:    
        try:
            wfm_in = int(wfm_in)
        except:
            wfm_in = 0               
else: wfm_in = 0


to_be_flattend = False
out0 = []

if not isinstance(input0, list) or len(input0)<2:
    input0=[input0]
    

TransactionManager.Instance.EnsureInTransaction(doc)
if len(input0)>=1:
    for str in input0:
        if isinstance(str, list):
            str = str[0]
        pat=FillPatternElement.GetFillPatternElementByName(doc,  FillPatternTarget.Drafting, str)  
        out0.append(pat)
else:
    str=input0[0]
    pat=FillPatternElement.GetFillPatternElementByName(doc,  FillPatternTarget.Drafting, str)  
    out0.append(pat)


TransactionManager.Instance.TransactionTaskDone()


try:
    # your code here
    pass


except (ZeroDivisionError, ValueError, IndexError, AttributeError, NameError) as err:
    debug.update({"Error":err})
debug.update({"wfm_out" : wfm_in +1})

if to_be_flattend==True:
    out0 = out0[0]


OUT = out0, debug
# ----------------------------------------
code_block = CodeBlock(a=getPatternByName) { a[0]; a[1]; }

# group: OUTPUT
PatternElement = Output(code_block.out0)
debug = Output(code_block.out1)
