# Dynamo custom node Ifc_Info.dyf (Dynamo 2.10.1.3976)
# category: GeoLogic.IFC
# Gets some basic information of an ifc file given its path as a string

# group: INPUT
filepath = Input(filepath: var[]..[])
options = Input(options: DesignScript.Builtin.Dictionary = DesignScript.Builtin.Dictionary.ByKeysValues(["wfm_in"], [0]))

# group: get ifc info using ifcopenshell
get_ifc_info = Python(IN[0]=filepath, IN[1]=options)  # CPython3
# ---------- get_ifc_info.python (140 lines) ----------
# This node is developed by Johannes Beck, 2022.
# Contact: geotechnicalbim@gmail.com

# Imports for Revit / Dynamo
# Append path for site packages
debug = {}
import System
import sys

try:    
    dirAppLoc = System.Environment.GetFolderPath(System.Environment.SpecialFolder.LocalApplicationData) 
    folder = (dirAppLoc + r'\python-3.8.3-embed-amd64\Lib\site-packages')
    sys.path.append(folder)
except FileNotFoundError as err:
    debug.update({"ImportErrorPath" : "site-packages folder not found in {0}. Please install all a custom python package first, e.g. pandas. Therefore follow the instructions on  https://github.com/DynamoDS/Dynamo/wiki/Customizing-Dynamo's-Python-3-installation ".format(folder)})

# for rollout, add used modules in "used_modules" list. It is checked, if the modules can be imported and if not, a message is added to the debug output.
used_modules = ["clr", "os", "ifcopenshell", "collections"]
try:
    import sys
    import clr
    import os
    import ifcopenshell
    from collections import Counter
except ImportError as err:
    debug.update({"ImportError": "A Python Module was not found - See ImportErrorInfo. Please install. For help on using external packages see https://github.com/DynamoDS/Dynamo/wiki/Customizing-Dynamo's-Python-3-installation".format(used_module)})
    debug.update({"ImportErrorInfo": "{}".format(err)})



clr.AddReference('ProtoGeometry')
from Autodesk.DesignScript.Geometry import *

# Color Nodes from Dynamo
clr.AddReference('DSCoreNodes')
import DSCore
from DSCore import Color

# Import GeometryColor _ Display in Dynamo
clr.AddReference('GeometryColor')
from Modifiers import GeometryColor

# Import RevitNodes
clr.AddReference("RevitNodes")
import Revit

# Import Revit elements
from Revit.Elements import *
import System

# Import DocumentManager and Transaction Manger
clr.AddReference("RevitServices")
import RevitServices
from RevitServices.Persistence import DocumentManager
from RevitServices.Transactions import TransactionManager

# Revit API
clr.AddReference('RevitAPI')
from Autodesk.Revit.DB import *
from Autodesk.Revit.DB.Structure import *

# Revit API Usier Ingerfavce
clr.AddReference('RevitAPIUI')
from Autodesk.Revit.UI import *


doc = DocumentManager.Instance.CurrentDBDocument
uidoc=DocumentManager.Instance.CurrentUIApplication.ActiveUIDocument
#Preparing input from dynamo to revit
#element = UnwrapElement(IN[0])
#TransactionManager.Instance.EnsureInTransaction(doc)
#TransactionManager.Instance.TransactionTaskDone()

# Assign Inputs IN of the python node
input0 = IN[0]
if len(IN) > 1:
    options = IN[1]
    if "wfm_in" in options.keys():
        wfm_in = options["wfm_in"]
    if not bool(wfm_in) or type(wfm_in)!=int:    
        try:
            wfm_in = int(wfm_in)
        except:
            wfm_in = 0               
else: wfm_in = 0

# Allows nested lists / dicts / tuples in the input 0. Two dimensonal only. 
if not hasattr(input0, '__iter__') or type(input0) == str:
    to_be_flattend = True
    input0 = [input0]
    out0 = [[]]
    debug.update({"on input":"input was not a list. Was converted"})
else: 
    to_be_flattend = False
    out0 = []


try:
    out0=[]
    filepaths = input0
    for ind_file in range(len(filepaths)):
        filepath = filepaths[ind_file]
        ifc_info = {}
        ifc_file = ifcopenshell.open(filepath)
        schema = ifcopenshell.ifcopenshell_wrapper.schema_by_name(ifc_file.schema)        
        filesize = os.path.getsize(filepath)/1048576 #bytes to mb
        anz_products = len(ifc_file.by_type('IfcProduct'))
        anz_buildingelem = len(ifc_file.by_type('IfcBuildingElement'))
        anz_proj = len(ifc_file.by_type('IfcProject'))
        anz_site = len(ifc_file.by_type('IfcSite'))
        ifc_project_line = str(ifc_file.by_type('IfcProject')[0])        
        
        
        ifc_info.update({
        "ifc schema":schema, 
        "file path": filepath,
        "file size": filesize,
        "count ifc products": anz_products,
        "count ifc building elements": anz_buildingelem,
        "count ifc project": anz_proj,
        "count ifc site": anz_site
        })
        
        
        out0.append(ifc_info)


except (ZeroDivisionError, ValueError, IndexError, AttributeError, NameError, OSError) as err:
    debug.update({"Error":err})
debug.update({
"wfm_out" : wfm_in +1,
"info" : "Node uses ifcopenshell. Please if not installed, download the right one at: http://ifcopenshell.org/python and put the unziped folder in your site package folder. For documentation see https://ifcopenshell.github.io/docs/python/html/ifcopenshell-python/api-documentation.html",
"tip" : "Don´t use dynamo on large files."
})

if to_be_flattend==True:
    out0 = out0[0]


OUT = out0, debug
# ----------------------------------------
code_block = CodeBlock(a=get_ifc_info) { a[0]; a[1]; }

# group: OUTPUT
info = Output(code_block.out0)
debug = Output(code_block.out1)
