# Dynamo custom node Interpolate_Points.dyf (Dynamo 2.10.1.3976)
# category: GeoLogic.Geometry
# Implementation of various interpolation methods. Interpolates z-values based on x,y values

# group: INPUT
points = Input(points: var[]..[])
options = Input(options: DesignScript.Builtin.Dictionary = DesignScript.Builtin.Dictionary.ByKeysValues(["wfm_in"], [0]))
InterpolationMethod = Input(InterpolationMethod: string = "linear")
resolution = Input(resolution: double = 5)

# group: Interpolate
interpolation_functions = Python(IN[0]=points, IN[1]=options, IN[2]=InterpolationMethod, IN[3]=resolution)  # CPython3
# ---------- interpolation_functions.python (369 lines) ----------
# This node is developed by Johannes Beck, 2022.
# Contact: geotechnicalbim@gmail.com

# Imports for Revit / Dynamo
# Append path for site packages

debug = {}
import System
import sys

try:    
    dirAppLoc = System.Environment.GetFolderPath(System.Environment.SpecialFolder.LocalApplicationData) 
    folder = (dirAppLoc + r'\python-3.8.3-embed-amd64\Lib\site-packages')
    sys.path.append(folder)
except FileNotFoundError as err:
    debug.update({"ImportErrorPath" : "site-packages folder not found in {0}. Please install all a custom python package first, e.g. pandas. Therefore follow the instructions on  https://github.com/DynamoDS/Dynamo/wiki/Customizing-Dynamo's-Python-3-installation ".format(folder)})



try:
    import clr
    import os
    import math
    import copy
    import numpy as np

    from pykrige.uk import UniversalKriging
    import pykrige.kriging_tools as kt
    from pykrige.ok import OrdinaryKriging
    import matplotlib.pyplot as plt

    from scipy.interpolate import RBFInterpolator
    from scipy.interpolate import LinearNDInterpolator
    from scipy.spatial import Delaunay
    from scipy.stats.qmc import Halton

except ImportError as err:
    debug.update({"ImportError": "A Python Module was not found - See ImportErrorInfo. Please install. For help on using external packages see https://github.com/DynamoDS/Dynamo/wiki/Customizing-Dynamo's-Python-3-installation. If this package is not needed for your interpolation method and you don´t want to install it, please outcomment manually in the python script".format(used_module)})
    debug.update({"ImportErrorInfo": "{}".format(err)})


clr.AddReference('ProtoGeometry')
from Autodesk.DesignScript.Geometry import *
from Autodesk.DesignScript.Geometry import Point as DynamoPoint
# Color Nodes from Dynamo
clr.AddReference('DSCoreNodes')
import DSCore
from DSCore import Color


# Import GeometryColor _ Display in Dynamo
clr.AddReference('GeometryColor')
from Modifiers import GeometryColor

# Import RevitNodes
clr.AddReference("RevitNodes")
import Revit

# Import Revit elements
from Revit.Elements import *
import System

# Import DocumentManager and Transaction Manger
clr.AddReference("RevitServices")
import RevitServices
from RevitServices.Persistence import DocumentManager
from RevitServices.Transactions import TransactionManager

# Revit API
clr.AddReference('RevitAPI')
from Autodesk.Revit.DB import *
from Autodesk.Revit.DB.Structure import *

# Revit API Usier Ingerfavce
clr.AddReference('RevitAPIUI')
from Autodesk.Revit.UI import *


doc = DocumentManager.Instance.CurrentDBDocument
uidoc=DocumentManager.Instance.CurrentUIApplication.ActiveUIDocument
#Preparing input from dynamo to revit
#element = UnwrapElement(IN[0])
#TransactionManager.Instance.EnsureInTransaction(doc)
#TransactionManager.Instance.TransactionTaskDone()


PointsKriging = []
def UnivKriging(Pts, IntBoundaries=True, resolution=5,resolution_x=5, resolution_y=5, VariogramModel="linear", DriftTerms="regional_linear", ToBeReturned="DynamoPoints"):
    # get max and min x and y values of the points to krige from
    PtsX, PtsY, PointsLst, PointsKriging = [],[],[],[]
    for pt in Pts:
        PtsX.append(pt.X)
        PtsY.append(pt.Y)
    PtsXmax, PtsYmax, PtsXmin, PtsYmin = max(PtsX), max(PtsY), min(PtsX), min(PtsY)
    # Setzten der räumlichen Grenzen auf Ganzzahlen (also statt 56.7 -> 57 m)
    if IntBoundaries == True:
        PtsXmax = float(math.ceil(PtsXmax))
        PtsYmax = float(math.ceil(PtsYmax))
        PtsXmin = float(math.floor(PtsXmin))
        PtsYmin = float(math.floor(PtsYmin))        
    gridx = np.arange(PtsXmin,PtsXmax+resolution_x,resolution_x)
    gridy = np.arange(PtsYmin,PtsYmax+resolution_y,resolution_y)

    for i in Pts:
        PointsLst.append([i.X, i.Y, i.Z]);
    data = np.array(PointsLst)
    UK = UniversalKriging(
        data[:, 0],
        data[:, 1],
        data[:, 2],
        variogram_model=VariogramModel,
        drift_terms=[DriftTerms]
    )    
    z, ss = UK.execute("grid", gridx, gridy)
    if ToBeReturned == "DynamoPoints":
        for i in range(len(z)):
            sublists = z[i]
            for i2 in range(len(sublists)):
                i2val = sublists[i2]
                PointKriging = DynamoPoint.ByCoordinates(gridx[i2],gridy[i],i2val)
                PointsKriging.append(PointKriging)
        return PointsKriging  


# Ordiniary Kriging validated with example 1 from Chapter 3 from Gau´s Dissertation (difference 16.796 ist, 16,791 soll)
def OrdiKriging(Pts, IntBoundaries=True, resolution=5,resolution_x=5, resolution_y=5, VariogramModel="linear",Verbose=False, ToBeReturned="DynamoPoints"):
    # get max and min x and y values of the points to krige from
    PtsX, PtsY, PointsLst, PointsKriging = [],[],[],[]
    for pt in Pts:
        PtsX.append(pt.X)
        PtsY.append(pt.Y)
    PtsXmax, PtsYmax, PtsXmin, PtsYmin = max(PtsX), max(PtsY), min(PtsX), min(PtsY)
    # Setzten der räumlichen Grenzen auf Ganzzahlen (also statt 56.7 -> 57 m)
    if IntBoundaries == True:
        PtsXmax = float(math.ceil(PtsXmax))
        PtsYmax = float(math.ceil(PtsYmax))
        PtsXmin = float(math.floor(PtsXmin))
        PtsYmin = float(math.floor(PtsYmin))        
    gridx = np.arange(PtsXmin,PtsXmax+resolution_x,resolution_x)
    gridy = np.arange(PtsYmin,PtsYmax+resolution_y,resolution_y)

    for i in Pts:
        PointsLst.append([i.X, i.Y, i.Z]);
    data = np.array(PointsLst)
    OK = OrdinaryKriging(
        data[:, 0],
        data[:, 1],
        data[:, 2],
        variogram_model=VariogramModel,
        verbose=Verbose,

    )    
    z, ss = OK.execute("grid", gridx, gridy)
    if ToBeReturned == "DynamoPoints":
        for i in range(len(z)):
            sublists = z[i]
            for i2 in range(len(sublists)):
                i2val = sublists[i2]
                PointKriging = DynamoPoint.ByCoordinates(gridx[i2],gridy[i],i2val)
                PointsKriging.append(PointKriging)
        return PointsKriging  


# For simple Kriging see blog:
#http://connor-johnson.com/2014/03/20/simple-kriging-in-python/ 




def RBF(Pts, IntBoundaries=True, resolution=5, resolution_x=5, resolution_y=5, ToBeReturned="DynamoPoints", kernel = "linear"):
# for documentation see: https://docs.scipy.org/doc/scipy/reference/reference/generated/scipy.interpolate.RBFInterpolator.html#scipy.interpolate.RBFInterpolator
    PtsX, PtsY, PointsLst, PtsZ, PtsXY, PointsRBF = [],[],[],[],[],[]
    for pt in Pts:
        PtsX.append(pt.X)
        PtsY.append(pt.Y)
        PtsZ.append(pt.Z)
    PtsXmax, PtsYmax, PtsXmin, PtsYmin = max(PtsX), max(PtsY), min(PtsX), min(PtsY)
    # Setzten der räumlichen Grenzen auf Ganzzahlen (also statt 56.7 -> 57 m)
    if IntBoundaries == True:
        PtsXmax = float(math.ceil(PtsXmax))
        PtsYmax = float(math.ceil(PtsYmax))
        PtsXmin = float(math.floor(PtsXmin))
        PtsYmin = float(math.floor(PtsYmin))        
    gridx = np.arange(PtsXmin,PtsXmax+resolution_x,resolution_x)
    gridy = np.arange(PtsYmin,PtsYmax+resolution_y,resolution_y)
    
    for i in Pts:
        PointsLst.append([i.X, i.Y, i.Z])
        PtsXY.append([i.X,i.Y])
    xobs = np.array(PtsXY)
    yobs = PtsZ
    xgrid = np.mgrid[int(PtsXmin):int(PtsXmax)+resolution_x:resolution_x, int(PtsYmin):int(PtsYmax)+resolution_y:resolution_y]
    #xgrid = np.mgrid[int(PtsYmin):int(PtsYmax)+resolution:resolution, int(PtsXmin):int(PtsXmax)+resolution:resolution]
    xflat = xgrid.reshape(2, -1).T
    yflat = RBFInterpolator(xobs, yobs,kernel=kernel)(xflat)   
    dimX=int(PtsXmax/resolution_x +1 - PtsXmin/resolution_x)
    dimY=int(PtsYmax/resolution_y +1 - PtsYmin/resolution_y)
    ygrid = yflat.reshape(dimX, dimY)
    #return ygrid    
    if ToBeReturned == "DynamoPoints":
        for i in range(len(yflat)):
            xflat_x= xflat[i,0]
            xflat_y= xflat[i,1]
            yflat_z= yflat[i]
            #listout.append([xflat_x,xflat_y,yflat_z])
            PointsRBF.append(DynamoPoint.ByCoordinates(xflat_x,xflat_y,yflat_z))
        return PointsRBF


def IDW_get_h(lon, lat, Pts):
# Code based on https://www.programmersought.com/article/95383860708/
    p0 = [lon, lat]
    sum0 = 0
    sum1 = 0
    temp = []
    # Traverse to get the distance of this point from all sampling points
    for point in Pts:
        if lon == point[0] and lat == point[1]:
            return point[2]
        Di = distance(p0, point)
        # new comes out an object, otherwise it will change the original lst value
        ptn = copy.deepcopy(point)
        ptn.append(Di)
        temp.append(ptn)
        # According to the above ptn.append () value sorted from small to large
    temp1 = sorted(temp, key=lambda point: point[3])
    # Traverse the first 15 points of the sort, find sum0 and sum1 according to the formula
    for point in temp1[0:15]:
        sum0 += point[2] / point[3]
        sum1 += 1 / point[3]
    return sum0 / sum1


def distance(p, pi):
    dis = (p[0] - pi[0]) * (p[0] - pi[0]) + (p[1] - pi[1]) * (p[1] - pi[1])
    m_result = math.sqrt(dis)
    return m_result            


def IDW (Pts, IntBoundaries=True, resolution=5, resolution_x=5, resolution_y=5, ToBeReturned="DynamoPoints"):
# for documentation see: https://docs.scipy.org/doc/scipy/reference/reference/generated/scipy.interpolate.RBFInterpolator.html#scipy.interpolate.RBFInterpolator
    # Kernel can be        
        #‘linear’ : -r
        #‘thin_plate_spline’ : r**2 * log(r)
        #‘cubic’ : r**3
        #‘quintic’ : -r**5
        #‘multiquadric’ : -sqrt(1 + r**2)
        #‘inverse_multiquadric’ : 1/sqrt(1 + r**2)
        #‘inverse_quadratic’ : 1/(1 + r**2)
        #‘gaussian’ : exp(-r**2)


    PtsX, PtsY, PointsLst, PtsZ, PtsXY, PtsXYZ, PointsIDW = [],[],[],[],[],[],[]
    for pt in Pts:
        PtsX.append(pt.X), PtsY.append(pt.Y), PtsZ.append(pt.Z)
        sublist = []
        sublist.append(pt.X), sublist.append(pt.Y), sublist.append(pt.Z)
        PtsXYZ.append(sublist)
    PtsXmax, PtsYmax, PtsXmin, PtsYmin = max(PtsX), max(PtsY), min(PtsX), min(PtsY)
    # Setzten der räumlichen Grenzen auf Ganzzahlen (also statt 56.7 -> 57 m)
    if IntBoundaries == True:
        PtsXmax = float(math.ceil(PtsXmax))
        PtsYmax = float(math.ceil(PtsYmax))
        PtsXmin = float(math.floor(PtsXmin))
        PtsYmin = float(math.floor(PtsYmin))   
    gridx = np.arange(PtsXmin,PtsXmax+resolution_x,resolution_x)
    gridy = np.arange(PtsYmin,PtsYmax+resolution_y,resolution_y)
    for i in gridx:     
        for i2 in gridy:
            z = IDW_get_h(i, i2, PtsXYZ)
            P1 = DynamoPoint.ByCoordinates(i,i2,z)
            PointsIDW.append(P1)            
    return PointsIDW

def LinearInterpolation (Pts, IntBoundaries=True, resolution=5, resolution_x=5, resolution_y=5, ToBeReturned="DynamoPoints"):
# for documentation see: https://docs.scipy.org/doc/scipy/reference/generated/scipy.interpolate.LinearNDInterpolator.html
    PtsX, PtsY, PointsLst, PtsZ, PtsXY, PointsLinear = [],[],[],[],[],[]
    for pt in Pts:
        PtsX.append(pt.X)
        PtsY.append(pt.Y)
        PtsZ.append(pt.Z)
    PtsXmax, PtsYmax, PtsXmin, PtsYmin = max(PtsX), max(PtsY), min(PtsX), min(PtsY)
    if IntBoundaries == True:
        PtsXmax = float(math.ceil(PtsXmax))
        PtsYmax = float(math.ceil(PtsYmax))
        PtsXmin = float(math.floor(PtsXmin))
        PtsYmin = float(math.floor(PtsYmin))        
    gridx = np.arange(PtsXmin,PtsXmax+resolution_x,resolution_x)
    gridy = np.arange(PtsYmin,PtsYmax+resolution_y,resolution_y)
    X, Y = np.meshgrid(gridx, gridy)
    interp = LinearNDInterpolator(list(zip(PtsX, PtsY)), PtsZ)
    Z = interp(X,Y)
    for i in range(len(X)):
        for i2 in range(len(X[i])):
            PointsLinear.append(DynamoPoint.ByCoordinates(X[i][i2], Y[i][i2], Z[i][i2]))
    return PointsLinear


# Assign Inputs IN of the python node
input0 = IN[0]
if len(IN) > 1:
    options = IN[1]
    if "wfm_in" in options.keys():
        wfm_in = options["wfm_in"]
    if not bool(wfm_in) or type(wfm_in)!=int:    
        try:
            wfm_in = int(wfm_in)
        except:
            wfm_in = 0 
    if "addpoints" in options.keys():
        addpoints = options["addpoints"]        
else: wfm_in = 0
interpolator = IN[2]
resolution = IN[3]


# Allows nested lists / dicts / tuples in the input 0. Two dimensonal only. 
if not hasattr(input0, '__iter__'):
    to_be_flattend = True
    input0 = [input0]
    try:
        input0[0].extend(addpoints)
    except NameError:
        pass
    out0 = [[]]
else: 
    # current implementation: only a list can be added for addtional points (not a nested one)
    for ind in range(len(input0)):
        try:
            # needs to be checked (nesting)
            input0 = input0.extend(addpoints)
        except NameError:
            pass
    to_be_flattend = False
    out0 = []



try:
    Points = input0
    # go through options
    resolution_x = options["resolution_x"] if "resolution_x" in options else resolution
    resolution_y = options["resolution_y"] if "resolution_y" in options else resolution
    IntBoundaries = options["IntBoundaries"] if "IntBoundaries" in options else True    
    VariogramModel = options["VariogramModel"] if "VariogramModel" in options else "linear" 
    kernel = options["kernel"] if "kernel" in options else "linear"
    
    if interpolator=="IDW":
        out0.append(IDW(Points, resolution=resolution, resolution_x=resolution_x, resolution_y=resolution_y, IntBoundaries=IntBoundaries))
    if interpolator in ["lin", "linear", "LIN", "Lin", "Linear"]:
        out0.append(LinearInterpolation(Points, resolution=resolution, resolution_x=resolution_x, resolution_y=resolution_y, IntBoundaries=IntBoundaries))
    if interpolator=="RBF": 
        out0.append(RBF(Points, resolution=resolution, resolution_x=resolution_x, resolution_y=resolution_y, IntBoundaries=IntBoundaries, kernel=kernel))
    if interpolator in ["OrdiKriging", "OKriging", "Krig", "Kriging"]:
        out0.append(OrdiKriging(Points, resolution=resolution, resolution_x=resolution_x, resolution_y=resolution_y, IntBoundaries=IntBoundaries, VariogramModel=VariogramModel))
    if interpolator=="UnivKriging":
        out0.append(UnivKriging(Points, resolution=resolution, resolution_x=resolution_x, resolution_y=resolution_y, IntBoundaries=IntBoundaries, VariogramModel=VariogramModel))
except (ZeroDivisionError, ValueError, IndexError, AttributeError, NameError) as err:
    debug.update({"Error":err})
debug.update({"wfm_out" : wfm_in +1,
"info": "This node interpolates the z values inbetween points given thier xyz position. A grind is layed in between. Integrated Interpolation Methods are linear, RBF, IDW, OrdiKriging, UnivKriging. As the more advanced ones are based on python libraries, please check them, if you need further tweaking.",
"about options" : "Options are passed in as a design script dict. Please Check the python node, if you want to know, what can be passed (as resolution_x, rosolution_y, Int_Boundaries, kernel, VariogramModel)"
})

if to_be_flattend==True:
    out0 = out0[0]


OUT = out0, debug, Points
# ----------------------------------------
code_block = CodeBlock(a=interpolation_functions) { a[0]; a[1]; }

# group: OUTPUT
Interpolated = Output(code_block.out0)
debug = Output(code_block.out1)
