# Dynamo custom node Place_Curved_Section_On_Sheet.dyf (Dynamo 2.10.1.3976)
# category: GeoLogic.Utils
# Places a curved section on a sheet
# Curced section is approximated by several linear sections which are alligned

# group: INPUT
NameOfSheet = Input(NameOfSheet: var[]..[])
NumberOfSheet = Input(NumberOfSheet: var[]..[])
FamType = Input(FamType: var[]..[])
# note: Node is a little sensitive.
# If you consider editing it: The sections must be an output of this node, otherwise it is not working as intendet.
# note: Default values and data types might be added
# note: Set "Schnittbereich" to invisible and hide level annotation might be usefull additions
RevitLine = Input(RevitLine: var[]..[])
NumberOfSections = Input(NumberOfSections: var[]..[])
BottomLevel = Input(BottomLevel: var[]..[])
TopLevel = Input(TopLevel: var[]..[])
SectionDepth = Input(SectionDepth: var[]..[])
SectionViewScale = Input(SectionViewScale: var[]..[])
options = Input(options: DesignScript.Builtin.Dictionary = DesignScript.Builtin.Dictionary.ByKeysValues(["wfm_in", "anpassung_x", "anpassung_y"], [0, 0, 0]))

# group: Herausfiltern von Linien aus der Auswahl
getCategory = Element.GetCategory(element=RevitLine)
categories = Categories("OST_Lines")
equals = List.Equals(objectA=getCategory, objectB=categories)
filterByBoolMask = List.FilterByBoolMask(list=RevitLine, mask=equals)
geometry = Element.Geometry(element=filterByBoolMask.in)
flatten = List.Flatten(list=geometry)

# group: Ordnen der Linien bei mehreren
byJoinedCurves = PolyCurve.ByJoinedCurves(curves=flatten)
explode = Geometry.Explode(geometry=byJoinedCurves)
reverse = Curve.Reverse(curve=explode)
reverse_2 = List.Reverse(list=reverse)

# group: Filtern Gerade und ungerade Linien
length = Curve.Length(curve=reverse_2)
startPoint = Curve.StartPoint(curve=reverse_2)
endPoint = Curve.EndPoint(curve=reverse_2)
distanceTo = Geometry.DistanceTo(geometry=startPoint, other=endPoint)
eq = length == distanceTo
filterByBoolMask_2 = List.FilterByBoolMask(list=reverse_2, mask=eq)

# group: Gerade Linien - Reverse
endPoint_2 = Curve.EndPoint(curve=filterByBoolMask_2.in)
startPoint_2 = Curve.StartPoint(curve=filterByBoolMask_2.in)
byStartPointEndPoint = Line.ByStartPointEndPoint(startPoint=endPoint_2, endPoint=startPoint_2)

# group: Gekruemmte Lininen (Splines) zu geraden Linien
code_block = CodeBlock(Schnitte=NumberOfSections) { 0..1..#Schnitte+1; }
pointAtParameter = Curve.PointAtParameter(curve=filterByBoolMask_2.out, param=code_block, lacing=CrossProduct)
code_block_2 = CodeBlock { 1; }
shiftIndices = List.ShiftIndices(amount=code_block_2)  # unwired: list
map = List.Map(list=pointAtParameter, function=shiftIndices)
byStartPointEndPoint_2 = Line.ByStartPointEndPoint(startPoint=pointAtParameter, endPoint=map)
code_block_3 = CodeBlock { 1; }
dropItems = List.DropItems(amount=code_block_3)  # unwired: list
map_2 = List.Map(list=byStartPointEndPoint_2, function=dropItems)

# group: List of Lines in ursprünglicher Reihenfolge
join = List.Join(list0=byStartPointEndPoint, list1=map_2)
indexOf = List.IndexOf(list=reverse_2, element=filterByBoolMask_2.in)
indexOf_2 = List.IndexOf(list=reverse_2, element=filterByBoolMask_2.out)
join_2 = List.Join(list0=indexOf, list1=indexOf_2)
code_block_4 = CodeBlock(a=join_2) { lst1=0..(List.Count(a)-1); List.IndexOf(a,lst1); }
reorder = List.Reorder(list=join, indices=code_block_4.out1)
flatten_2 = List.Flatten(list=reorder)
reverse_3 = List.Reverse(list=flatten_2)

# group: Get Coordinate System of Sections
endPoint_3 = Curve.EndPoint(curve=reverse_3)
direction = Line.Direction(line=reverse_3)
reverse_4 = Vector.Reverse(vector=direction)
ZAxis = Vector.ZAxis()
code_block_5 = CodeBlock { 90; }
rotate = Vector.Rotate(vector=direction, axis=ZAxis, degrees=code_block_5)
byOriginVectors = CoordinateSystem.ByOriginVectors(origin=endPoint_3, xAxis=reverse_4, yAxis=ZAxis, zAxis=rotate)

# group: Get CropSize and Depth of Sections
elevation = Level.Elevation(level=BottomLevel)
byCoordinates = Point.ByCoordinates(y=elevation)
length_2 = Curve.Length(curve=reverse_3)
elevation_2 = Level.Elevation(level=TopLevel)
byCoordinates_2 = Point.ByCoordinates(x=length_2, y=elevation_2, z=SectionDepth)
byCoordinateSystemMinPointMaxPoint = SectionView.ByCoordinateSystemMinPointMaxPoint(cs=byOriginVectors, minPoint=byCoordinates, maxPoint=byCoordinates_2)

# group: Handle options
python_script = Python(IN[1]=options)  # CPython3; unwired: IN[0]
# ---------- python_script.python (59 lines) ----------
# This node is developed by Johannes Beck, 2022.
# Contact: geotechnicalbim@gmail.com

# Imports for Revit / Dynamo



debug = {}

import sys
import clr
import os


clr.AddReference('ProtoGeometry')
from Autodesk.DesignScript.Geometry import *
from Autodesk.DesignScript.Geometry import Point as DynamoPoint




input0 = IN[0]
if len(IN) > 1:
    options = IN[1]
    wfm_in = options["wfm_in"] if "wfm_in" in options.keys() else 0
    if not bool(wfm_in) or type(wfm_in)!=int:    
        try:
            wfm_in = int(wfm_in)
        except:
            wfm_in = 0
    anpassung_x = options["anpassung_x"] if "anpassung_x" in options.keys() else 0
    anpassung_y = options["anpassung_y"] if "anpassung_y" in options.keys() else 0     
else: wfm_in, anpassung_x, anpassung_y = 0, 0, 0


# Allows nested lists / dicts / tuples in the input 0. Two dimensonal only. 
if not hasattr(input0, '__iter__'):
    to_be_flattend = True
    input0 = [input0]
    out0 = [[]]
else: 
    to_be_flattend = False
    out0 = []


try:
    # your code here
    1+1


except (ZeroDivisionError, ValueError, IndexError, AttributeError, NameError) as err:
    debug.update({"Error":err})
debug.update({"wfm_out" : wfm_in +1})

if to_be_flattend==True:
    out0 = out0[0]


OUT = debug, anpassung_x, anpassung_y
# ----------------------------------------
code_block_6 = CodeBlock(a=python_script) { debug = a[0]; anpassung_x = a[1]; anpassung_y = a[2]; }

# group: Create Section View
setScale = View.SetScale(view=byCoordinateSystemMinPointMaxPoint, scale=SectionViewScale)
code_block_7 = CodeBlock(CurveLength=length_2) { CurveLength; }
python_script_2 = Python(IN[0]=code_block_7)  # CPython3
# ---------- python_script_2.python (19 lines) ----------
# Phython-Standard- und DesignScript-Bibliotheken laden
import sys
import clr
clr.AddReference('ProtoGeometry')
from Autodesk.DesignScript.Geometry import *

# Die Eingaben für diesen Block werden in Form einer Liste in den IN-Variablen gespeichert.
values = IN[0]
Aufsummiert = []

CurrentNumber=-1*values[0]
for i in values:
    CurrentNumber=CurrentNumber+i
    Aufsummiert.append(CurrentNumber)
    
# Code unterhalb dieser Linie platzieren

# Weisen Sie Ihre Ausgabe der OUT-Variablen zu.
OUT = Aufsummiert
# ----------------------------------------
code_block_8 = CodeBlock(a=python_script_2, b=SectionViewScale) { a/b; a; }
code_block_9 = CodeBlock(anpassung_y=code_block_6.anpassung_y) { 0.5+anpassung_y; 0; }

code_block_10 = CodeBlock(a=code_block_8.out0, anpassung_x=code_block_6.anpassung_x) { b=a-1+anpassung_x; }

# group (continued): Create Section View
byCoordinates_3 = Point.ByCoordinates(x=code_block_10, y=code_block_9.out0)
byNameNumberTitleBlockViewsAndLocations = Sheet.ByNameNumberTitleBlockViewsAndLocations(sheetName=NameOfSheet, sheetNumber=NumberOfSheet, titleBlockFamilyType=FamType, views=setScale, locations=byCoordinates_3)

# group: OUTPUT
CreatedSheet = Output(byNameNumberTitleBlockViewsAndLocations)
CreatedSections = Output(setScale)
debug = Output(code_block_6.debug)
