# Dynamo custom node Python_From_String.dyf (Dynamo 2.13.1.3887)
# category: GeoLogic.Utils
# PythonFromString with default python environment setup

# note: Running a python script from string using exec()
IN_0 = Input(IN_0: var[]..[])
script = Input(script: string = "pass")
python_script = Python(IN[0]=IN_0, IN[1]=script)  # CPython3
# ---------- python_script.python (126 lines) ----------
# This node is developed by Johannes Beck, 2022.
# Contact: geotechnicalbim@gmail.com


#_________________________________________________
# INIT SECTION
# helpers for imports
using_revit = True
using_dynamo = True

# Initialize default outputs
debug = {}
out0, out1, out2, out3 = [], [], [], []


#_________________________________________________
# IMPORT SECTION
# Imports for Revit / Dynamo
# Append path for site packages. As different Autodesk products are delivered with different versions of embedded python (e.g. Revit 2022 uses 3.8.3 and Revit / Formit 2023 3.8.10), the current running version is catched
import System
import sys

try:    
    dirAppLoc = System.Environment.GetFolderPath(System.Environment.SpecialFolder.LocalApplicationData) 
    python_version = sys.version[:sys.version.index("(")-1]
    folder = (dirAppLoc + r"\python-{0}-embed-amd64\Lib\site-packages".format(python_version))
    sys.path.append(folder)
except FileNotFoundError as err:
    debug.update({"ImportErrorPath" : "site-packages folder not found in your python version. Follow the instructions on  https://github.com/DynamoDS/Dynamo/wiki/Customizing-Dynamo's-Python-3-installation"})

try:
    import clr
    import os
    import math
    import itertools
    import time
    #import pandas as pd
    import numpy as np
    import scipy
except (ImportError, ValueError) as err:
    debug.update({"ImportError": "A Python Module was not found - See ImportErrorInfo. Please install. For help on using external packages see https://github.com/DynamoDS/Dynamo/wiki/Customizing-Dynamo's-Python-3-installation"})
    debug.update({"ImportErrorInfo": "{}".format(err)})

if using_dynamo:
    # Import Dynamo Geometry. Attention to names of classes, that are used by several imported libraries.
    clr.AddReference("ProtoGeometry")
    from Autodesk.DesignScript.Geometry import *
    from Autodesk.DesignScript.Geometry import Point as DynamoPoint
    from Autodesk.DesignScript.Geometry import Line as DynamoLine

    # Import Color Nodes from Dynamo
    clr.AddReference('DSCoreNodes')
    import DSCore
    from DSCore import Color

    # Import GeometryColor _ Display in Dynamo
    clr.AddReference('GeometryColor')
    from Modifiers import GeometryColor

if using_revit:
    # Import RevitNodes
    clr.AddReference("RevitNodes")
    import Revit
    # Import Revit elements
    from Revit.Elements import *

    # Import DocumentManager and Transaction Manger
    clr.AddReference("RevitServices")
    import RevitServices
    from RevitServices.Persistence import DocumentManager
    from RevitServices.Transactions import TransactionManager

    # Revit API
    clr.AddReference('RevitAPI')
    from Autodesk.Revit.DB import *
    from Autodesk.Revit.DB.Structure import *

    # Revit API User Interface
    clr.AddReference('RevitAPIUI')
    from Autodesk.Revit.UI import *

    doc = DocumentManager.Instance.CurrentDBDocument
    uidoc=DocumentManager.Instance.CurrentUIApplication.ActiveUIDocument


#_________________________________________________
# INPUT SECTION
# Assign Inputs IN of the python node. Use UnwrapElement when working with elements from Revit in Dynamo. Uncomment Transaction Manager if working with Revit Transactions
#TransactionManager.Instance.EnsureInTransaction(doc)
input0 = UnwrapElement(IN[0])



# ASSIGN YOUR INPUT VARIABLE NAMES HERE


    

# Allows nested lists / dicts / tuples in the input IN[0]. Two dimensonal only.
if not hasattr(input0, '__iter__') or isinstance(input0, str):
    to_be_flattend = True
    input0 = [input0]
else: 
    to_be_flattend = False
    

#_________________________________________________
# MAIN SECTION

exec(IN[1])

#TYPE YOUR CODE HERE. LET IT BE AWESOME!



#_________________________________________________    
# OUTPUT SECTION        
# Uncomment Transaction Manager if working with Revit Transactions
#TransactionManager.Instance.TransactionTaskDone()

# Flattening if input was not a list
if to_be_flattend==True:
    if len(out0)!=0:
        out0 = out0[0]
        
OUT = debug, out0
# ----------------------------------------
OUT = Output(python_script)
