# Dynamo custom node Python_Template.dyf (Dynamo 2.13.1.3887)
# category: GeoLogic.Utils
# This node contains a general python template for working with Revit / Dynamo

python_script = Python()  # CPython3; unwired: IN[0]
# ---------- python_script.python (116 lines) ----------
# This node is developed by Johannes Beck, 2022.
# Contact: geotechnicalbim@gmail.com


# Imports for Revit / Dynamo
# Append path for site packages
debug = {}
import System
import sys

try:    
    dirAppLoc = System.Environment.GetFolderPath(System.Environment.SpecialFolder.LocalApplicationData) 
    folder = (dirAppLoc + r'\python-3.8.3-embed-amd64\Lib\site-packages')
    sys.path.append(folder)
except FileNotFoundError as err:
    debug.update({"ImportErrorPath" : "site-packages folder not found in {0}. Please install all a custom python package first, e.g. pandas. Therefore follow the instructions on  https://github.com/DynamoDS/Dynamo/wiki/Customizing-Dynamo's-Python-3-installation ".format(folder)})

try:
    import clr
    import os
    #import math
    #import itertools
    #import time
    #import pandas as pd
    #import numpy as np
    #import scipy
except ImportError as err:
    debug.update({"ImportError": "A Python Module was not found - See ImportErrorInfo. Please install. For help on using external packages see https://github.com/DynamoDS/Dynamo/wiki/Customizing-Dynamo's-Python-3-installation".format(used_module)})
    debug.update({"ImportErrorInfo": "{}".format(err)})
    
clr.AddReference('ProtoGeometry')
from Autodesk.DesignScript.Geometry import *
from Autodesk.DesignScript.Geometry import Point as DynamoPoint

# Color Nodes from Dynamo
clr.AddReference('DSCoreNodes')
import DSCore
from DSCore import Color

# Import GeometryColor _ Display in Dynamo
clr.AddReference('GeometryColor')
from Modifiers import GeometryColor

# Import RevitNodes
clr.AddReference("RevitNodes")
import Revit

# Import Revit elements
from Revit.Elements import *
import System

# Import DocumentManager and Transaction Manger
clr.AddReference("RevitServices")
import RevitServices
from RevitServices.Persistence import DocumentManager
from RevitServices.Transactions import TransactionManager

# Revit API
clr.AddReference('RevitAPI')
from Autodesk.Revit.DB import *
from Autodesk.Revit.DB.Structure import *

# Revit API User Ingerface
clr.AddReference('RevitAPIUI')
from Autodesk.Revit.UI import *


doc = DocumentManager.Instance.CurrentDBDocument
uidoc=DocumentManager.Instance.CurrentUIApplication.ActiveUIDocument
#Preparing input from dynamo to revit
#element = UnwrapElement(IN[0])
#TransactionManager.Instance.EnsureInTransaction(doc)

#_________________________________________________
# Assign Inputs IN of the python node
input0 = IN[0]

#_________________________________________________
if len(IN) > 1:
    options = IN[1]
    wfm_in = options["wfm_in"] if "wfm_in" in options.keys() else 0
    if not bool(wfm_in) or type(wfm_in)!=int:    
        try:
            wfm_in = int(wfm_in)
        except:
            wfm_in = 0               
else: wfm_in = 0


# Allows nested lists / dicts / tuples in the input 0. Two dimensonal only. Please take care if your input are strings
if not hasattr(input0, '__iter__'):
    to_be_flattend = True
    input0 = [input0]
    out0 = [[]]
else: 
    to_be_flattend = False
    out0 = []

#_________________________________________________
try:
    # your code here
    1+1


#_________________________________________________

    
except (ZeroDivisionError, ValueError, IndexError, AttributeError, NameError) as err:
    debug.update({"Error":err})
debug.update({"wfm_out" : wfm_in +1})
#TransactionManager.Instance.TransactionTaskDone()
if to_be_flattend==True:
    out0 = out0[0]

# Define Output of Dynamo Python Node
OUT = out0, debug
# ----------------------------------------
python_out = Output(python_script)
code_block = CodeBlock()
# ---------- code_block.designscript (3 lines) ----------
"This node contains my personal python template for Dynamo / Revit.
It can be used for the regular python node following the steps documented here:
https://primer.dynamobim.org/10_Custom-Nodes/10-6_Python-Templates.html";
# ----------------------------------------
AboutThisNode = Output(code_block)
