# Dynamo custom node Random_Points.dyf (Dynamo 2.10.1.3976)
# category: GeoLogic.Geometry
# Creates a given number of randomly placed Dynamo Points

# group: INPUTS
NumberOfPoints = Input(NumberOfPoints: var[]..[])
options = Input(options: DesignScript.Builtin.Dictionary = DesignScript.Builtin.Dictionary.ByKeysValues(["wfm_in"], [0]))

# group: Create random points
python_script = Python(IN[0]=NumberOfPoints, IN[1]=options)  # CPython3
# ---------- python_script.python (89 lines) ----------
# This node is developed by Johannes Beck, 2022.
# Contact: geotechnicalbim@gmail.com


# Imports for Revit / Dynamo
# Append path for site packages
debug = {}
import System
import sys

try:
    import clr
    import os
    import random

except ImportError as err:
    debug.update({"ImportError": "A Python Module was not found - See ImportErrorInfo. Please install. For help on using external packages see https://github.com/DynamoDS/Dynamo/wiki/Customizing-Dynamo's-Python-3-installation".format(used_module)})
    debug.update({"ImportErrorInfo": "{}".format(err)})
    
clr.AddReference('ProtoGeometry')
from Autodesk.DesignScript.Geometry import *
from Autodesk.DesignScript.Geometry import Point as DynamoPoint


#_________________________________________________
# Assign Inputs IN of the python node
input0 = IN[0]

#_________________________________________________
if len(IN) > 1:
    options = IN[1]
    wfm_in = options["wfm_in"] if "wfm_in" in options.keys() else 0
    if not bool(wfm_in) or type(wfm_in)!=int:    
        try:
            wfm_in = int(wfm_in)
        except:
            wfm_in = 0
    x_min = options["x_min"] if "x_min" in options.keys() else 0
    y_min = options["y_min"] if "y_min" in options.keys() else 0
    z_min = options["z_min"] if "z_min" in options.keys() else 0

    x_max = options["x_max"] if "x_max" in options.keys() else 100
    y_max = options["y_max"] if "y_max" in options.keys() else 100
    z_max = options["z_max"] if "z_max" in options.keys() else 10
else: 
    wfm_in = x_min = y_min= z_min= 0
    x_max = y_max = 100
    z_max = 10



# Allows nested lists / dicts / tuples in the input 0. Two dimensonal only. Please take care if your input are strings

if not hasattr(input0, '__iter__'):
    to_be_flattend = True
    input0 = [input0]
    out0 = []
else: 
    to_be_flattend = False
    out0 = []

#_________________________________________________
try:
    # your code here
    for elem in input0:
        point_collector = []
        for i in range(int(elem)):
            x_val = x_min + random.random() * (x_max-x_min)
            y_val = y_min + random.random() * (y_max-y_min)
            z_val = z_min + random.random() * (z_max-z_min)
            p1 = DynamoPoint.ByCoordinates(x_val, y_val, z_val)
            point_collector.append(p1)
        out0.append(point_collector)        


#_________________________________________________

    
except (ZeroDivisionError, ValueError, IndexError, AttributeError, NameError) as err:
    debug.update({"Error":err})
debug.update({"wfm_out" : wfm_in +1})
#TransactionManager.Instance.TransactionTaskDone()
if to_be_flattend==True:
    out0 = out0[0]

debug.update({"info":"Creates random Dynamo Points. Required input is the number of points."})
debug.update({"on options":"Takes x_min, y_min, z_min, x_max, y_max, z_max. Must be integers or floats"})
# Define Output of Dynamo Python Node
OUT = out0, debug
# ----------------------------------------
code_block = CodeBlock(lst=python_script) { points=lst[0]; debug=lst[1]; }

# group: Output
Points = Output(code_block.points)
debug = Output(code_block.debug)
