# Dynamo custom node Solid_By_Top_Bottom_Polysurface.dyf "SolidByTopBottomPolysurface" (Dynamo 2.10.1.3976)
# category: GeoLogic.Geometry
# Creates a solid from a top and bottom polysurface by splitting it into surfaces, extruding their perimeter curves to solid and calculating the boolean difference.
# Top and Bottom Surface need the same amount of vertices / surfaces to work as expected

# group: INPUTS
top_polysurface = Input(top_polysurface: Autodesk.DesignScript.Geometry.PolySurface)
bottom_polysurface = Input(bottom_polysurface: Autodesk.DesignScript.Geometry.PolySurface)
options = Input(options: DesignScript.Builtin.Dictionary = DesignScript.Builtin.Dictionary.ByKeysValues(["wfm_in"], [0]))

# group: Find a suiting extrusion lenght
byGeometry = BoundingBox.ByGeometry(geom=top_polysurface)
maxPoint = BoundingBox.MaxPoint(boundingBox=byGeometry)
Z = Point.Z(point=maxPoint)
byGeometry_2 = BoundingBox.ByGeometry(geom=bottom_polysurface)
minPoint = BoundingBox.MinPoint(boundingBox=byGeometry_2)
Z_2 = Point.Z(point=minPoint)
code_block = CodeBlock(z_max=Z, z_min=Z_2) { d=1+z_max-z_min; d2= (-1)*d; }

# group: Process geometry
surfaces = PolySurface.Surfaces(polySurface=top_polysurface)
perimeterCurves = Surface.PerimeterCurves(surface=surfaces)
byJoinedCurves = PolyCurve.ByJoinedCurves(curves=perimeterCurves)
ZAxis = Vector.ZAxis()
extrudeAsSolid = Curve.ExtrudeAsSolid(curve=byJoinedCurves, direction=ZAxis, distance=code_block.d2)
# note: Extrude upper surface downwards
# Extrude lower surface upwards
surfaces_2 = PolySurface.Surfaces(polySurface=bottom_polysurface)
perimeterCurves_2 = Surface.PerimeterCurves(surface=surfaces_2)
byJoinedCurves_2 = PolyCurve.ByJoinedCurves(curves=perimeterCurves_2)
ZAxis_2 = Vector.ZAxis()
extrudeAsSolid_2 = Curve.ExtrudeAsSolid(curve=byJoinedCurves_2, direction=ZAxis_2, distance=code_block.d)
intersect = Geometry.Intersect(geometry=extrudeAsSolid, other=extrudeAsSolid_2)
flatten = List.Flatten(list=intersect)
byUnion = Solid.ByUnion(solids=flatten)

# group: INFO / WFM
options_manager = Python(IN[0]=options)  # CPython3
# ---------- options_manager.python (25 lines) ----------
# This node is developed by Johannes Beck, 2022.
# Contact: geotechnicalbim@gmail.com

# Imports for Revit / Dynamo
# Append path for site packages

import sys
import clr
if len(IN) > 1:
    options = IN[0]
    if "wfm_in" in options.keys():
        wfm_in = options["wfm_in"]
    if not bool(wfm_in) or type(wfm_in)!=int:    
        try:
            wfm_in = int(wfm_in)
        except:
            wfm_in = 0               
else: wfm_in = 0

debug = {}
debug.update({"info": "This node creates a solid based on a top and bottom polysurface. Top and bottom polysurfaces must consist of the same amount of surfaces"})
debug.update({"wfm_out" : wfm_in +1})


OUT = debug
# ----------------------------------------

# group: OUTPUTS
solid = Output(byUnion)
debug = Output(options_manager)
