# Dynamo custom node Solid_By_Top_Bottom_Surface.dyf (Dynamo 2.10.1.3976)
# category: GeoLogic.Geometry
# Creates a solid given a top and bottom surface by computing the perimeter curves. Tries to loft in between them and then creates a solid by joining the surfaces.
# Quality of the result varies...

# group: INPUTS
bottom_polysurface = Input(bottom_polysurface: var[]..[])
top_polysurface = Input(top_polysurface: var[]..[])
options = Input(options: DesignScript.Builtin.Dictionary = DesignScript.Builtin.Dictionary.ByKeysValues(["wfm_in"], [0]))

# group: To Solid using perimeters and brep approach
code_block = CodeBlock()
# ---------- code_block.designscript (8 lines) ----------
"
import clr
out0=[]
for i in range(len(IN[0])):
	out0.append(list(zip(IN[0][i], IN[1][i])))
OUT = out0
#OUT=zip(IN[0][0], IN[1][0])
";
# ----------------------------------------
perimeterCurves = Surface.PerimeterCurves(surface=bottom_polysurface)
startPoint = Curve.StartPoint(curve=perimeterCurves)
X = Point.X(point=startPoint)
sortByKey = List.SortByKey(list=perimeterCurves, keys=X, lacing=Shortest)
perimeterCurves_2 = Surface.PerimeterCurves(surface=top_polysurface)
startPoint_2 = Curve.StartPoint(curve=perimeterCurves_2)
X_2 = Point.X(point=startPoint_2)
sortByKey_2 = List.SortByKey(list=perimeterCurves_2, keys=X_2, lacing=Shortest)
python_script_from_string = PythonStringNode(script=code_block, IN[0]=sortByKey.sortedList, IN[1]=sortByKey_2.sortedList)  # CPython3
byLoft = PolySurface.ByLoft(crossSections=python_script_from_string)
addItemToEnd = List.AddItemToEnd(item=top_polysurface, list=byLoft, lacing=Longest)
addItemToEnd_2 = List.AddItemToEnd(item=bottom_polysurface, list=addItemToEnd, lacing=Longest)
byJoinedSurfaces = Solid.ByJoinedSurfaces(facesOfSolid=addItemToEnd_2)

# group: INFO / WFM
options_manager = Python(IN[0]=options)  # CPython3
# ---------- options_manager.python (25 lines) ----------
# This node is developed by Johannes Beck, 2022.
# Contact: geotechnicalbim@gmail.com

# Imports for Revit / Dynamo
# Append path for site packages

import sys
import clr
if len(IN) > 1:
    options = IN[0]
    if "wfm_in" in options.keys():
        wfm_in = options["wfm_in"]
    if not bool(wfm_in) or type(wfm_in)!=int:    
        try:
            wfm_in = int(wfm_in)
        except:
            wfm_in = 0               
else: wfm_in = 0

debug = {}
debug.update({"info": "This node creates a solid based on a top and bottom polysurface. Top and bottom polysurfaces must consist of the same amount of surfaces"})
debug.update({"wfm_out" : wfm_in +1})


OUT = debug
# ----------------------------------------

# group: OUTPUT
Solid = Output(byJoinedSurfaces)
debug = Output(options_manager)
