# Dynamo custom node Triangulate_Delauny.dyf (Dynamo 2.10.1.3976)
# category: GeoLogic.Geometry
# Creates a triangulated surface given a selection of DynamoPoints. Retruns either Topo, Surfaces, PolySurface or Mesh

# group: INPUT
points = Input(points: var[])
options = Input(options: DesignScript.Builtin.Dictionary = DesignScript.Builtin.Dictionary.ByKeysValues(["wfm_in"], [0]))
ToBeReturned = Input(ToBeReturned: string = "PolySurface")

# group: Triangulate Delauny
triangulate_Delauny = Python(IN[0]=points, IN[1]=options, IN[2]=ToBeReturned)  # CPython3
# ---------- triangulate_Delauny.python (166 lines) ----------
# This node is developed by Johannes Beck, 2022.
# Contact: geotechnicalbim@gmail.com

# Imports for Revit / Dynamo
# Append path for site packages
debug = {}
import System
import sys

try:    
    dirAppLoc = System.Environment.GetFolderPath(System.Environment.SpecialFolder.LocalApplicationData) 
    folder = (dirAppLoc + r'\python-3.8.3-embed-amd64\Lib\site-packages')
    sys.path.append(folder)
except FileNotFoundError as err:
    debug.update({"ImportErrorPath" : "site-packages folder not found in {0}. Please install all a custom python package first, e.g. pandas. Therefore follow the instructions on  https://github.com/DynamoDS/Dynamo/wiki/Customizing-Dynamo's-Python-3-installation ".format(folder)})


# for rollout, add used modules in "used_modules" list. It is checked, if the modules can be imported and if not, a message is added to the debug output.
try:
    import sys
    import clr
    import os   
    from scipy.spatial import Delaunay
    from scipy.stats.qmc import Halton
    import numpy as np
except ImportError as err:
    debug.update({"ImportError": "A Python Module was not found - See ImportErrorInfo. Please install. For help on using external packages see https://github.com/DynamoDS/Dynamo/wiki/Customizing-Dynamo's-Python-3-installation".format(used_module)})
    debug.update({"ImportErrorInfo": "{}".format(err)})
    

clr.AddReference('ProtoGeometry')
from Autodesk.DesignScript.Geometry import *
from Autodesk.DesignScript.Geometry import Point as DynamoPoint
from Autodesk.DesignScript.Geometry import Surface as DynamoSurface

# Color Nodes from Dynamo
clr.AddReference('DSCoreNodes')
import DSCore
from DSCore import Color

# Import GeometryColor _ Display in Dynamo
clr.AddReference('GeometryColor')
from Modifiers import GeometryColor

# Import RevitNodes
clr.AddReference("RevitNodes")
import Revit

# Import Revit elements
from Revit.Elements import *
import System

# Import DocumentManager and Transaction Manger
clr.AddReference("RevitServices")
import RevitServices
from RevitServices.Persistence import DocumentManager
from RevitServices.Transactions import TransactionManager

# Revit API
clr.AddReference('RevitAPI')
from Autodesk.Revit.DB import *
from Autodesk.Revit.DB.Structure import *

# Revit API Usier Ingerfavce
clr.AddReference('RevitAPIUI')
from Autodesk.Revit.UI import *

# Import MeshToolkit 
clr.AddReference('MeshToolkit')
import Autodesk.Dynamo.MeshToolkit as mtk

doc = DocumentManager.Instance.CurrentDBDocument
uidoc=DocumentManager.Instance.CurrentUIApplication.ActiveUIDocument
#Preparing input from dynamo to revit
#element = UnwrapElement(IN[0])
#TransactionManager.Instance.EnsureInTransaction(doc)
#TransactionManager.Instance.TransactionTaskDone()

# Assign Inputs IN of the python node

def MeshDelauny (Pts, IntBoundaries=True, ToBeReturned="DynamoPolySurface"):
    Surfaces, PolySurfaces, PointsLst, PtsZ, PtsXY, Polygons = [],[],[],[],[],[]
    for pt in Pts:
        PtsXY.append([pt.X, pt.Y])
    PointArray = np.array(PtsXY)
    if ToBeReturned == "DynamoPolygon" or ToBeReturned == "DynamoPolySurface" or ToBeReturned == "DynamoSurfaces" or ToBeReturned =="DynamoMesh":
        tri = Delaunay(PointArray)
        for i in tri.simplices:
            sublist = []
            for i2 in i:
                sublist.append(Pts[int(i2)])
            Polygon1 = Polygon.ByPoints(sublist)
            Polygons.append(Polygon1)
        if ToBeReturned == "DynamoPolygon":
            return Polygons
        #TO BE COMPLETED
        #if ToBeReturned == "DynamoMesh":
         #   DynamoMesh = Mesh.ByPointsFaceIndices(.....)
         #   return DynamoMesh
        if ToBeReturned in ["DynamoSurfaces","DynamoPolySurface", "DynamoMesh"]:
            for i in Polygons:
                Surfaces.append(DynamoSurface.ByPatch(i))
        if ToBeReturned == "DynamoSurfaces":
            return Surfaces
        if ToBeReturned == "DynamoPolySurface" or ToBeReturned == "DynamoMesh":
            PolySurface1 = PolySurface.ByJoinedSurfaces(Surfaces)
            if ToBeReturned == "DynamoPolySurface":
                return PolySurface1
            else:
                mesh = mtk.Mesh.ByGeometry(PolySurface1)
                return mesh
            
input0 = IN[0]
if len(IN) > 1:
    options = IN[1]
    if "wfm_in" in options.keys():
        wfm_in = options["wfm_in"]
    if not bool(wfm_in) or type(wfm_in)!=int:    
        try:
            wfm_in = int(wfm_in)
        except:
            wfm_in = 0               
else: wfm_in = 0



ToBeReturned = IN[2]

# Allows nested lists / dicts / tuples in the input 0. Two dimensonal only. 
if not hasattr(input0, '__iter__'):
    to_be_flattend = True
    input0 = [input0]
    out0 = [[]]
else: 
    to_be_flattend = False
    out0 = []




try:
    Points = input0
    debug.update({"type at index 0":type(Points[0])})
    Points = [Points] if hasattr(Points[0], "X") else Points
    if ToBeReturned in ["Topo", "RvtTopo", "Topographie", "topograhy", "Topograhy"]:
        for point_list in Points:
            out0.append(Topography.ByPoints(point_list))
    else:    
        ToBeReturned = "DynamoSurfaces" if IN[2] in ["DynamoSurfaces", "Surfaces", "surfaces"] else "DynamoPolySurface"
        ToBeReturned = "DynamoPolySurface" if IN[2] in ["PolySurface", "Polysurface", "polysurfce"] else "DynamoPolySurface"
        ToBeReturned = "DynamoMesh" if IN[2] in ["Mesh", "DynamoMesh", "mesh"] else "DynamoPolySurface"    
        for point_list in Points:
            out0.append(MeshDelauny(point_list, ToBeReturned=ToBeReturned))

except (ZeroDivisionError, ValueError, IndexError, AttributeError, NameError, TypeError) as err:
    debug.update({"Error":err})
debug.update({"wfm_out" : wfm_in +1,
"info": "This Node creates triangulated geometry based on Delauny Triangulation",
"on output options": "Either: DynamoPolySurface, DynamoSurfaces, DynamoMesh or RvtTopo"
})

if to_be_flattend==True:
    out0 = out0[0]


OUT = out0, debug
# ----------------------------------------
code_block = CodeBlock(a=triangulate_Delauny) { a[0]; a[1]; }

# group: OUTPUT
Triangulated = Output(code_block.out0)
debug = Output(code_block.out1)
